# Grasshopper definition demo.gh (Grasshopper 1.0.7)

path = FilePath("/Users/mnmly/Downloads/gh-js-demo/dist/gh-js-demo.e31bb0bc.js")
pop2d = Populate2D(Region={Plane=PlaneXY(0, 0, 0), Size=Domain2(u=0..20, v=0..10)}, Count=100, Seed=1)
read_file = ReadFile(path=path, x=Button())  # -> out, contents
# ---------- read_file: Python ----------
__author__ = "mnmly"

import rhinoscriptsyntax as rs

with open(path, 'r') as fp:
    contents = fp.read()
# ---------- end read_file ----------
panel = Panel(read_file.contents)
c_script = CSharpScript(
    script=read_file.contents,
    points=pop2d,
    Reference="/Users/mnmly/Development-local/RhinoPlugins/GhJavaScript/GhJavaScript/bin/Debug/net45/Jint.dll")  # -> out, A, B; inputs script: String, points: list of Point3d
# ---------- c_script: C# ----------
var engine = new Jint.Engine(cfg => cfg.AllowClr());
var data = new List<Point2d>();
foreach (var item in points) {
    data.Add(new Point2d(item.X, item.Y));
}
B = data;

var val = engine
    .SetValue("Point2d", typeof(Point2d))
    .SetValue("d", data.ToArray())
    .Execute( script + Environment.NewLine + "global.run(d)")
    .GetCompletionValue();

List<object> list = (val.ToObject() as IEnumerable<object>).Cast<object>().ToList();


Grasshopper.DataTree<Point3d> tree = new Grasshopper.DataTree<Point3d>();

var i = 0;
foreach (var item in list){
    var o = item as IDictionary<string, object>;
    var p0 = new Point3d((double)o["x0"], (double)o["y0"], 0.0);
    var p1 = new Point3d((double)o["x1"], (double)o["y1"], 0.0);
    var bound = new List<Point3d> {p0, p1};
    tree.AddRange(bound, new GH_Path(i));
    i ++;
}

A = tree;
# ---------- end c_script ----------
item = ListItem(List=c_script.A, Index=0, Wrap=True)  # -> Item, Item1
rec_2pt = Rectangle2Pt(Plane=PlaneXY(0, 0, 0), PointA=item.Item, PointB=item.Item1, Radius=0)  # -> Rectangle, Length
panel_2 = Panel(c_script.B)
panel_3 = Panel(c_script.A)
concat = Concatenate(FragmentA=panel, FragmentB="; function add(a, b) { return a + b; }")
panel_4 = Panel(concat)
